# Requirement set requirements (R2023a)

## 1 [#1] Stop button
When the vehicle is driving automatically the control panel shall provide the technician with the ability to stop the vehicle in a controlled manner with a button.

### 1.1 [#5] Stop button malfunction
When the stop button malfunctions the vehicle shall execute controlled stop with shutdown

## 2 [#4] Execution of controlled stop
When the controlled stop is initiated the truck shall use the braking torque of its driving unit to stop itself.

### 2.1 [#3] Deceleration level for controlled stop
The controlled stop shall achieve -10 m/s2 deceleration.

### 2.2 [#2] Emergency stop for low deceleration
When the controlled stop doesn't achieve the described deceleration level the vehicle shall initiate emergency stop.

## 3 [#6] Controlled stop with shutdown
When the vehicle executed a controlled stop with shutdown, the power of its driving unit shall shutdown.

### 3.1 [#7] Deceleration level for controlled stop
The controlled stop with shutdown shall achieve -10 m/s2 deceleration.